# Grasshopper definition inputs.ghx (Grasshopper 1.0.7)

input_slider = Slider(0.25, range=0..1)  # disabled
input_num = Number()
input_python = GhPythonScript()  # -> pt
# ---------- input_python: Python ----------
import Rhino.Geometry as rg

pt = rg.Point3d(x,x,x)
# ---------- end input_python ----------
input_bool = Boolean()
multiplication = Multiplication()
input_txt = Text()
input_int = Integer()
output_data = Data([input_num, input_int, input_txt, input_bool, input_slider, input_python, multiplication])
panel = Panel(output_data)
